# Dynamo graph 1B. Update Sheet List.dyn "Create Sheet List" (Dynamo 2.19.3.6394)

# group: Get Data from Excel. SDN/SName/SNumber
file_path = Filename("C:\Users\pc\Desktop\Sheet List.xlsx")  # graph input
file_from_path = FileObject(path=file_path)
string = StringInput("Sheet List")
importExcel = Data.ImportExcel(file=file_from_path, sheetName=string)
transpose = List.Transpose(lists=importExcel)

# group: Create New One > Get SheetName only ( Excel )
code_block = CodeBlock { 2; }
getItemAtIndex = List.GetItemAtIndex(list=transpose, index=code_block)

code_block_2 = CodeBlock { 1; }
getItemAtIndex_2 = List.GetItemAtIndex(list=transpose, index=code_block_2)

# group: Updated Ones > Get SheetName only ( Excel )
code_block_3 = CodeBlock { 2; }
getItemAtIndex_3 = List.GetItemAtIndex(list=transpose, index=code_block_3)

# group: Get SDN only ( Excel )
code_block_4 = CodeBlock { 0; }
getItemAtIndex_4 = List.GetItemAtIndex(list=transpose, index=code_block_4)

# group: Check Parameter of Sheet: Submission DWG No
categories = Categories("OST_Sheets")
all_elements_of_category = ElementsOfCategory(Category=categories)
code_block_5 = CodeBlock { "Submission Dwg No"; }

# group: Get SDN only ( Revit )
getParameterValueByName = Element.GetParameterValueByName(element=all_elements_of_category, parameterName=code_block_5)
contains = List.Contains(list=getParameterValueByName, item=getItemAtIndex_4@L1)

# group: Split the List to Update In = Update
filterByBoolMask = List.FilterByBoolMask(list=getItemAtIndex_4, mask=contains)
allIndicesOf = List.AllIndicesOf(list=getItemAtIndex_4, item=filterByBoolMask.in)
flatten = List.Flatten(list=allIndicesOf)

# group: Create New One > Get SheetNumber only ( Excel )
code_block_6 = CodeBlock { 1; }
getItemAtIndex_5 = List.GetItemAtIndex(list=transpose, index=code_block_6)

# group: Updated Ones > Get SheetNumber only ( Excel )
code_block_7 = CodeBlock { 1; }
getItemAtIndex_6 = List.GetItemAtIndex(list=transpose, index=code_block_7)

# group: Updated Ones
categories_2 = Categories("OST_Sheets")
all_elements_of_category_2 = ElementsOfCategory(Category=categories_2)
code_block_8 = CodeBlock { t1 = "Sheet Number"; t2 = "Sheet Name"; }
getItemAtIndex_7 = List.GetItemAtIndex(list=getItemAtIndex_3, index=flatten)
sheet_name = Element.SetParameterByName(element=all_elements_of_category_2, parameterName=code_block_8.t2, value=getItemAtIndex_7)
getItemAtIndex_8 = List.GetItemAtIndex(list=getItemAtIndex_6, index=flatten)
sheet_number = Element.SetParameterByName(element=all_elements_of_category_2, parameterName=code_block_8.t1, value=getItemAtIndex_8)

# group: Dataflow Control ( VERY IMPORTANT )
code_block_9 = CodeBlock { "Sheet Number"; }
getParameterValueByName_2 = Element.GetParameterValueByName(element=sheet_name, parameterName=code_block_9)
contains_2 = List.Contains(list=getParameterValueByName_2, item=getItemAtIndex_2@L1)
filterByBoolMask_2 = List.FilterByBoolMask(list=getItemAtIndex_2, mask=contains_2)
allIndicesOf_2 = List.AllIndicesOf(list=getItemAtIndex_2, item=filterByBoolMask_2.out)

# group: Create New One
getItemAtIndex_9 = List.GetItemAtIndex(list=getItemAtIndex, index=allIndicesOf_2)
getItemAtIndex_10 = List.GetItemAtIndex(list=getItemAtIndex_5, index=allIndicesOf_2)
family_types = FamilyTypes("A1 metric:A1 metric")
create_sheet_name_number = Sheet.ByNameNumberTitleBlock(sheetName=getItemAtIndex_9, sheetNumber=getItemAtIndex_10, titleBlockFamilyType=family_types)
code_block_10 = CodeBlock { "Submission Dwg No"; }
assign_stable_key = Element.SetParameterByName(element=create_sheet_name_number, parameterName=code_block_10, value=getItemAtIndex_4)
