# Dynamo graph Create CoL Rebar.dyn "test_rebar1" (Dynamo 2.19.3.6394)
# packages: Chynamo 0.8.5, BIM4Struc.Rebar 1.3.0, GH Dynamo Rebar for R24 2024.217.1012

select_model_element = DSModelElementSelection()  # 1 picked in the model; graph input
id = Element.Id(element=select_model_element)
faces = Element.Faces(element=select_model_element)
code_block = CodeBlock { 0; }
getItemAtIndex = List.GetItemAtIndex(list=faces, index=code_block)
curves = Custom[Curves](surface=getItemAtIndex)  # package Chynamo; Get all closed PolyCurves of Surface, first item is the perimeter PolyCurve, rest are the hole edges
cover_in_mm = CodeBlock { 25; }
rebar_dia_of_stirrup = RevitRebarBarType("10M")  # graph input
getBarDiameter = Custom[RebarType.GetBarDiameter](rebarBarType=rebar_dia_of_stirrup)  # package BIM4Struc.Rebar; Get the diameter of a given Rebar Bar Type
code_block_2 = CodeBlock(cover=cover_in_mm, dia=getBarDiameter) { -(cover+0.5*dia); }
offset = Custom[Offset](curve=curves, OffsetDistance=code_block_2)  # package Chynamo; Safe offset curve, minus distance will return a smaller curve or a closer curve to [0,0,0]
ZAxis = Vector.ZAxis()
string = StringInput("Length")
getParameterValueByName = Element.GetParameterValueByName(element=select_model_element, parameterName=string)
number = DoubleInput(100)  # graph input
s1_bar_spacing_in_first_third = CodeBlock(s1=number) { s1; }  # "S1 - Bar Spacing in First & Third Spacing"
number_2 = DoubleInput(200)  # graph input
s2_bar_spacing_in_2nd_segment = CodeBlock(s2=number_2) { s2; }
start_end_offset = CodeBlock(l=getParameterValueByName, S1=s1_bar_spacing_in_first_third, S2=s2_bar_spacing_in_2nd_segment)
# ---------- start_end_offset.designscript (14 lines) ----------
// l is Length of Structural Column
// Ls = Length of rebar = l - 2*50, 50 is Start/End Offset
Le = l - 50*2;
// a is Segment with different spacing
a = Le/4;
// Number of segment
nor1 = Math.Round(a/S1,0);
Lr1  = nor1*S1;
//
nor2 = Math.Round(2*a/S2) - 1*2;
Lr2  = nor2*S2;
// Number of bars
n1 = nor1+1;
n2 = nor2+1;
# ----------------------------------------
code_block_3 = CodeBlock(Lr1=start_end_offset.Lr1, Le=start_end_offset.Le, Lr2=start_end_offset.Lr2)
# ---------- code_block_3.designscript (6 lines) ----------
//First Offset
50;
//Second Offset
50+Lr1+(Le-2*Lr1-Lr2)*0.50;
//Third Offset;
50+Lr1+Lr2+(Le-2*Lr1-Lr2);
# ----------------------------------------
translate = Geometry.Translate(geometry=offset, direction=ZAxis, distance=code_block_3.out0)
translate_2 = Geometry.Translate(geometry=offset, direction=ZAxis, distance=code_block_3.out1)
translate_3 = Geometry.Translate(geometry=offset, direction=ZAxis, distance=code_block_3.out2)
list_create = List.Create(item0=translate, item1=translate_2, item2=translate_3)
rebarStyle = RevitRebarStyle("StirrupTie")
code_block_4 = CodeBlock(dia=rebar_dia_of_stirrup) { dia; }
rebarHookType = RevitRebarHookType("Stirrup/Tie - 135 deg.")
rebarHookOrientation = RevitRebarHookOrientation("Left")
normal = Curve.Normal(curve=list_create)
rebarFromCurves = GH.RebarExtension.CreateRebar.RebarFromCurves(curves=list_create, rebarStyle=rebarStyle, rebarBarType=code_block_4, startHookType=rebarHookType, endHookType=rebarHookType, startHookOrientation=rebarHookOrientation, endHookOrientation=rebarHookOrientation, vector=normal)
list_create_2 = List.Create(item0=start_end_offset.n1, item1=start_end_offset.n2, item2=start_end_offset.n1)
list_create_3 = List.Create(item0=s1_bar_spacing_in_first_third, item1=s2_bar_spacing_in_2nd_segment, item2=s1_bar_spacing_in_first_third)
setLayoutAsNumberWithSpacing = GH.RebarExtension.Layout.SetLayoutAsNumberWithSpacing(rebar=rebarFromCurves, numberOfBarPositions=list_create_2, spacing=list_create_3)
code_block_5 = CodeBlock {  }
