# Dynamo graph test_rebar1.dyn (Dynamo 2.19.3.6394)
# packages: Chynamo 0.8.5, BIM4Struc.Rebar 1.3.0, Dynamo for Rebar 2.0.2

code_block = CodeBlock { 25+0.5*10; }
offset = Custom[Offset]()  # package Chynamo; Safe offset curve, minus distance will return a smaller curve or a closer curve to [0,0,0]; unwired: curve
select_model_element = DSModelElementSelection()  # 1 picked in the model
getRebarCover = Custom[Element.GetRebarCover](element=select_model_element)  # package BIM4Struc.Rebar; Get the rebar cover dimensions for a selected element.
getBarDiameter = Custom[RebarType.GetBarDiameter]()  # package BIM4Struc.Rebar; Get the diameter of a given Rebar Bar Type; unwired: rebarBarType
set_rebar_diameter = RebarBarType(ElementType="Autodesk.Revit.DB.Structure.RebarBarType, RevitAPI, Version=24.3.40.0, Culture=neutral, PublicKeyToken=null")  # nothing selected; graph input; graph output
faces = Element.Faces(element=select_model_element)
code_block_2 = CodeBlock { 0; }
getItemAtIndex = List.GetItemAtIndex(list=faces, index=code_block_2)
curves = Custom[Curves](surface=getItemAtIndex)  # package Chynamo; Get all closed PolyCurves of Surface, first item is the perimeter PolyCurve, rest are the hole edges
offsetMany = PolyCurve.OffsetMany(polyCurve=curves)  # unwired: signedDistance, extendCircular
